# Grasshopper definition VALGEN.gh (Grasshopper 1.0.8)
# Copyright: 2020
# plug-ins: Karamba3D, Pufferfish, DeCodingSpaces, Human, MetaHopper, HDTTreeUtils, Shortest Walk in Gh

corridor_width = Slider(1, range=0..1)
wall_thickness = Slider(0.2, range=0..1)
room_height = Slider(3.4, range=0..10)
division = Division(A=wall_thickness, B=2)
neg = Negative(Value=division)
target_cell_size = Slider(1, range=0..1)
number_slider = Slider(6789, range=0..10000)
cluster = Cluster(A="C:\Users\kane\Documents\GitHub\HVM_Generative")  # -> simplify(L)
forced_spacing = Slider(0, range=0..100)
number_slider_2 = Slider(11, range=0..100)
python = GhPythonScript(data=cluster, unit_size=target_cell_size)  # -> out, total_element_no, elements, el_crvs; inputs data: tree
# ---------- python: Python ----------
__author__ = "kane"
__version__ = "2020.04.15"

import rhinoscriptsyntax as rs
from ghpythonlib import treehelpers as th
from ghpythonlib import components as ghcomp
import Rhino.Geometry as rg

data = th.tree_to_list(data, None)

class Element:
    def __init__(self, id, name, sideA, sideB, height, group_id):
        self.origin = (0,0)
        self.flip = False
        self.id = id
        self.name = name
        self.shape = (sideA,sideB)
        self.height = height
        self.group_id = group_id
    
    def __repr__(self):
        return str(self.name)


names, side_A, side_B, height, group_ids, duplicates = data[1], [int(float(i)) for i in data[2]], [int(float(i)) for i in data[3]], [int(float(i)) for i in data[4]], [int(float(i)) for i in data[6]], [int(float(i)) for i in data[8]]
total_element_no = 0
elements = []
el_crvs = []
plane = ghcomp.XYPlane(rg.Point3d(0,0,0))
for i, number in enumerate(duplicates):
    for j in range(number):
        elements.append(Element(i, names[i], int(side_A[i]/unit_size), int(side_B[i]/unit_size), height[i], group_ids[i]))
        el_crvs.append(ghcomp.Rectangle(plane, ghcomp.ConstructDomain(0, side_A[i]),ghcomp.ConstructDomain(0, side_B[i]),0)[0])
        total_element_no += 1
print el_crvs
elements = th.list_to_tree(elements)
# ---------- end python ----------
num = Number([7, 31, 58, 11, 48, 22, 59, 40, 43, 5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])
ladybug = Ladybug_Ladybug()  # -> Vviiiiiiiiiizzz; plug-in component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
honeybee = Honeybee_Honeybee()  # -> Vviiiiiiiiiizzz; plug-in component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
lng = ListLength(List=python.el_crvs)

# ---- group: Change from outside in to inside out
population = Slider(111, range=0..1000)
rectangle = Rectangle(Plane=PlaneXY(0, 0, 0), XSize=population, YSize=population, Radius=0)  # -> Rectangle, Length
pop2d = Populate2D(Region=rectangle.Rectangle, Count=lng, Seed=Slider(10000, range=0..10000))
move = Move(Geometry=python.el_crvs, Motion=pop2d)  # -> Geometry, Transform

# ----
offset = Offset(Curve=move.Geometry, Distance=corridor_width, Plane=PlaneXY(0, 0, 0), Corners=1)
pcen = PolygonCenter(Polyline=graft(offset))  # -> CenterV, CenterE, CenterA
explode = Explode(Curve=offset, Recursive=True)  # -> Segments, Vertices
disc = Discontinuity(Curve=offset, Level=1)  # -> Points, Parameters
line = Line(explode.Segments)
pt = Point(flatten(pcen.CenterE))
lng_2 = ListLength(List=flatten(line))
pt_2 = Point([disc.Points, pcen.CenterE])
crossref = CrossReference(ListA=pt_2, ListB=pt_2, CrossMode=5)  # -> ListA, ListB
dup = DuplicateData(Data=wall_thickness, Number=lng_2, Order=True)
ln = Line(StartPoint=crossref.ListA, EndPoint=crossref.ListB)

# ---- group: Angular snapping
angle_multiple = Slider(0.5, range=0..1)
item = ListItem(List=ln, Index=0, Wrap=True)  # -> flatten(Item)
crossref_2 = CrossReference(ListA=item, ListB=item, CrossMode=5)  # -> ListA, ListB
pi = Pi(Factor=angle_multiple)
as = AngleSnap(LineA=crossref_2.ListA, LineB=crossref_2.ListB, Factor=pi, Strength=Slider(10000, range=0..10000))

# ----
replace = ReplaceItems(List=dup, Item="2", Indices=num, Wrap=False)

# ---- group: keep everything on the plane
cullpt = CullDuplicates(Points=flatten(explode.Vertices), Tolerance=0.1, CullMode=3)  # -> Points, Indices, Valence
anchorxyz = AnchorXYZ(Point=cullpt.Points, X=False, Y=False, Z=True, Strength=1000)

# ----
flatten = FlattenTree(Tree=disc.Points, Path="{0}")
python_2 = GhPythonScript(elements=python.elements)  # -> out, name, id, gid; inputs elements: list
# ---------- python_2: Python ----------
__author__ = "kane"
__version__ = "2020.04.16"

name, id, gname, gid = [],[],[],[]
for el in elements:
    name.append(el.name)
    id.append(el.id)
    gid.append(el.group_id)
# ---------- end python_2 ----------

# ---- group: Group based
data = Data(python_2.gid)
cset = CreateSet(List=data)  # -> Set, Map
mindex = MemberIndex(Set=data, Member=cset.Set)  # -> Index, Count
item_2 = ListItem(List=pt, Index=mindex.Index, Wrap=True)

# ----
tag = TextTag(Location=pcen.CenterE, Text=graft(python_2.name))
item_3 = ListItem(List=item_2, Index=0, Wrap=True)  # -> flatten(Item)
crossref_3 = CrossReference(ListA=item_2, ListB=item_2, CrossMode=5)  # -> ListA, ListB
ln_2 = Line(StartPoint=crossref_3.ListA, EndPoint=crossref_3.ListB)  # -> flatten(Line)
crossref_4 = CrossReference(ListA=item_3, ListB=item_3, CrossMode=5)  # -> ListA, ListB
ln_3 = Line(StartPoint=crossref_4.ListA, EndPoint=crossref_4.ListB)  # -> flatten(Line)
cull_i = CullIndex(List=ln_3, Indices=number_slider_2, Wrap=True)
item_4 = ListItem(List=ln_3, Index=number_slider_2, Wrap=True)
collider = Collider(Objects=flatten(line), Radii=dup, Strength=1000)

# ---- group: Allows dragging with Alt+LMB
grab = Grab(On=True, Strength=100, Range=3)  # -> Grab, Anchors

# ----
ms = MagnetSnap(Points=flatten, Range=0.5, Strength=100)
length_line = LengthLine(Line=ln, Strength=1000)
length_line_2 = LengthLine(Line=ln_2, Length=0, Strength="0.2")
length_line_3 = LengthLine(Line=cull_i, Length=forced_spacing, Strength="0.2")
length_line_4 = LengthLine(Line=item_4, Length=forced_spacing, Strength="0.4")
show = Show(G=offset)
bnd = Bounds(Numbers=python_2.id)
dedomain = DeconstructDomain(Domain=bnd)  # -> Start, End
Z = UnitZ(Factor=room_height)
entwine = Entwine(
    Branch00=show,
    Branch01=[collider, anchorxyz],
    Branch02=length_line,
    Branch03=length_line_2,
    Branch04=[length_line_3, length_line_4],
    Branch05=as,
    FlattenInputs=True)  # -> simplify(Result)
gradient = Gradient(
    LowerLimit=dedomain.Start,
    UpperLimit=dedomain.End,
    Parameter=python_2.id,
    stops=[0: RGB(243, 57, 0), 0.1: RGB(236, 27, 60), 0.2: RGB(210, 0, 118), 0.3: RGB(103, 0, 120), 0.398: RGB(39, 72, 161), 0.5: RGB(1, 192, 229), 0.6: RGB(18, 178, 90), 0.7: RGB(79, 186, 8), 0.8: RGB(220, 237, 32), 0.9: RGB(247, 159, 20), 1: RGB(243, 57, 0)])
zombiesolver = ZombieSolver(GoalObjects=simplify(entwine), Threshold=1e-10, Tolerance=0.01, MaxIterations=10000)  # -> I, V, O
lng_3 = ListLength(List=entwine)  # -> flatten(Length)
this_only_works_with_rectangles = Panel("4")
material = CreateMaterial(Diffuse=gradient, Specular=RGB(255, 255, 255), Emission=RGB(0, 0, 0), Transparency=Slider(0.71, range=0..1), Shine=0)
partition = PartitionList(List=zombiesolver.O, Size=lng_3)  # -> simplify(Chunks)
bang = ExplodeTree(Data=partition)  # -> Branch0, Branch1, Branch2, Branch3, Branch4, Branch5
offset_2 = Offset(Curve=bang.Branch0, Distance=expr("x*2", division), Plane=PlaneXY(0, 0, 0), Corners=1)
run_solar_analysis = BooleanToggle(False)

# ---- group: Cleanup Clustor
cluster_2 = Cluster_7(C=offset_2)  # -> pl, P
cluster_3 = Cluster_8(C=cluster_2.pl, P=cluster_2.P, T=Slider(0.7, range=0..1))  # -> pl, V
cluster_4 = Cluster_7(C=cluster_3.pl)  # -> simplify(pl), P

# ----
panel = Panel("https://www.energyplus.net/weather-download/north_and_central_america_wmo_region_4/USA/PA/USA_PA_Philadelphia.Intl.AP.724080_TMY3/all")

# ---- group: hours to test
panel_2 = Panel("9")
panel_3 = Panel("12")
panel_4 = Panel("17")

# ----
epw_stat = Ladybug_OpenEPWAndSTATWeatherFiles(weatherFileURL=panel)  # -> epwFile, statFile; plug-in component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
crv = Curve(cluster_4.pl)
crv_2 = Curve(flatten(crv))
runion = RegionUnion(Curves=flatten(crv_2))

# ---- group: Inner Path Logic - Finds most reasonable place to place access point based on linear proximity
lng_4 = ListLength(List=crv_2)
series = Series(Start=0, Step=1, Count=lng_4)
crossref_5 = CrossReference(ListA=series, ListB=series, CrossMode=3)  # -> ListA, ListB
item_5 = ListItem(List=crv_2, Index=crossref_5.ListA, Wrap=True)
item_6 = ListItem(List=crv_2, Index=crossref_5.ListB, Wrap=True)
area = Area(Geometry=item_5)  # -> Area, Centroid
crv_cp = CurveClosestPoint(Point=area.Centroid, Curve=item_6)  # -> Point, Parameter, Distance
assign_paths = AssignPaths(InputData=flatten(crv_cp.Parameter), PathsToAssign=flatten(crossref_5.ListB))
assign_paths_2 = AssignPaths(InputData=flatten(crv_cp.Point), PathsToAssign=flatten(crossref_5.ListB))
avr = Average(Input=assign_paths_2)
cp = ClosestPoint(Point=avr, Cloud=assign_paths_2)  # -> flatten(ClosestPoint), CPIndex, Distance
item_7 = ListItem(List=assign_paths, Index=cp.CPIndex, Wrap=True)
shatter = Shatter(Curve=simplify(graft(crv_2)), Parameters=item_7)
crossref_6 = CrossReference(ListA=cp.ClosestPoint, ListB=cp.ClosestPoint, CrossMode=3)  # -> ListA, ListB
ln_4 = Line(StartPoint=crossref_6.ListA, EndPoint=crossref_6.ListB)
explode_2 = Explode(Curve=shatter, Recursive=True)  # -> flatten(Segments), Vertices
rdlines = RemoveDuplicateLinesKaramba3D(Line=ln_4, LimitDistance=0.005)  # -> OutLine, Info, Indexes

# ----
pcen_2 = PolygonCenter(Polyline=graft(crv))  # -> CenterV, CenterE, CenterA
genclimatebasedsky = Honeybee_GenerateClimateBasedSky(weatherFile=epw_stat.epwFile, month="6", day="21", hour=[panel_2, panel_3, panel_4])  # -> radiationValues, skyFilePath; plug-in component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
explode_3 = Explode(Curve=crv, Recursive=True)  # -> Segments, Vertices
item_8 = ListItem(List=explode_3.Segments, Index="0", Wrap=True)  # -> simplify(Item)
eval = EvaluateCurve(Curve=reparameterize(item_8), Parameter=Slider(0.25, range=0..1))  # -> flatten(Point), Tangent, Angle
network_smooth = NetworkSmooth(Network=flatten(explode_2.Segments), SnapThreshold=Slider(0.5, range=0..1), SnapToAnchorPointsOnly=False)
network2segments = NetworkToSegments(NetworkGeometry=network_smooth, ConvertCurves=True, ConversionAngle=0.2, Split=True)
explode_4 = Explode(Curve=network2segments, Recursive=True)  # -> flatten(Segments), Vertices
crv_3 = Curve(explode_4.Segments)
xy = XYPlane(Origin=Point(0, 0, 0))
Z_2 = UnitZ(Factor=-1)
data_2 = Data(crv)
midpt = CurveMiddle(Curve=crv_3)
shortwalk = ShortestWalk(Curves=flatten(crv_3), WantedPath=rdlines.OutLine)  # -> ShortestWalk, Succession, Direction, Length
Z_3 = UnitZ(Factor=2)
explode_5 = Explode(Curve=shortwalk.ShortestWalk, Recursive=True)  # -> flatten(Segments), Vertices
rdlines_2 = RemoveDuplicateLinesKaramba3D(Line=explode_5.Segments, LimitDistance=0.005)  # -> OutLine, Info, Indexes
midpt_2 = CurveMiddle(Curve=rdlines_2.OutLine)
cp_2 = ClosestPoint(Point=midpt_2, Cloud=midpt)  # -> ClosestPoint, CPIndex, Distance
cull_i_2 = CullIndex(List=crv_3, Indices=cp_2.CPIndex, Wrap=True)
ext = ExtendCurve(Curve=rdlines_2.OutLine, Type=0, Start=corridor_width, End=corridor_width)
offcrv = OffsetCurve(Curve=ext, Plane=PlaneXY(0, 0, 0), Distance=corridor_width, BothSides=True, Kinks=0, CapType=1)  # -> flatten(Offset)
runion_2 = RegionUnion(Curves=offcrv)
trim = TrimWithRegions(Curve=crv_3, Regions=runion_2, Plane=xy)  # -> Inside, Outside
crv_4 = Curve(trim.Inside)
crv_5 = Curve(trim.Outside)
disc_2 = Discontinuity(Curve=runion_2, Level=1)  # -> Points, Parameters
pline = PolyLine(Vertices=disc_2.Points, Closed=True)
redpline = Reduce(Polyline=pline, Tolerance=0.1)  # -> Polyline, Reduction
python_3 = GhPythonScript(x=runion_2)  # -> out, internal_rooms, outer_borders; inputs x: list of Curve
# ---------- python_3: Python ----------
__author__ = "kane"
__version__ = "2020.05.28"

import rhinoscriptsyntax as rs
import Rhino.Geometry as rg
from Rhino.RhinoDoc import ActiveDoc as rhdoc
tol = rhdoc.ModelAbsoluteTolerance
Parent_region_containment = [[] for i in x]
for a in range(len(x)):
    for b in range(a, len(x)):
        if a != b:
            test = rg.Curve.PlanarClosedCurveRelationship(x[a],x[b], rg.Plane.WorldXY, tol).value__
            if test == 1:
                pass
            elif test == 2:
                Parent_region_containment[b].append(a) #"AInsideB"
            elif test == 3: 
                Parent_region_containment[a].append(b) #"BInsideA"

internal_rooms, outer_borders = [],[]
for i,lst in enumerate(Parent_region_containment):
    if lst == []:
        internal_rooms.append(x[i])
    else:
        outer_borders.append(x[i])
# ---------- end python_3 ----------
cluster_5 = Cluster_9(P=redpline.Polyline)  # -> flatten(pl)
rdiff = RegionDifference(CurvesA=flatten(data_2), CurvesB=runion_2)
boundary = BoundarySurfaces(Edges=runion_2)
move_2 = Move(Geometry=boundary, Motion=Z_2)  # -> Geometry, Transform
extr = Extrude(Base=move_2.Geometry, Direction=Z_3)
trim_2 = TrimWithBrep(Curve=crv_4, Brep=extr)  # -> Inside, Outside
crv_6 = Curve(trim_2.Outside)
offcrv_2 = OffsetCurve(
    Curve=flatten([crv_5, crv_6]),
    Plane=PlaneXY(0, 0, 0),
    Distance=expr("x/2", wall_thickness),
    BothSides=True,
    Kinks=0,
    CapType=1)  # -> flatten(Offset)
cluster_6 = Cluster_9(P=cluster_5)  # -> flatten(pl)
offcrv_3 = OffsetCurve(Curve=graft(cluster_6), Plane=PlaneXY(0, 0, 0), Distance=expr("x/2", wall_thickness), BothSides=True, Kinks=0, CapType=1)
boundary_2 = BoundarySurfaces(Edges=data_2)
merge = Merge(Data1=flatten(rdiff), Data2=flatten(python_3.internal_rooms))
boundary_3 = BoundarySurfaces(Edges=offcrv_2)
boundary_4 = BoundarySurfaces(Edges=simplify(offcrv_3), UseTasks=True)
boundary_5 = BoundarySurfaces(Edges=cluster_6)
cluster_7 = Cluster_5(P=merge)  # -> flatten(pl)
runion_3 = RegionUnion(Curves=flatten([boundary_2, cluster_6]))
cluster_8 = Cluster_6(C=cluster_7)  # -> flatten(pl)

# ---- group: Points in front of Doors
point = Point(cp.ClosestPoint)
point_2 = Point(cp.ClosestPoint)

# ----
viewing_range = Slider(100, range=0..100)

# ---- group: Outside Boundary
area_2 = Area(Geometry=runion_3)  # -> Area, Centroid
sort = SortList(Keys=area_2.Area, ValuesA=runion_3)  # -> Keys, reverse(ValuesA)
item_9 = ListItem(List=sort.ValuesA, Index=0, Wrap=True)

# ----
number_slider_3 = Slider(2, range=0..10)
null = NullItem(Item=cluster_8)  # -> NullFlags, InvalidFlags, Description
occlusivity = Panel("6")  # disabled

# ---- group: Isovist
rdpoints = RemoveDuplicatePointsKaramba3D(Point=flatten(explode_5.Vertices), LimitDistance=0.005)  # -> OutPoint, Info, Indexes
lng_5 = ListLength(List=rdpoints.OutPoint)
explode_6 = Explode(Curve=merge, Recursive=True)  # -> flatten(Segments), Vertices
sqr = Square(Value=lng_5)
isovist = Isovist(
    VantagePointS=flatten(rdpoints.OutPoint),
    ObstacleLines=explode_6.Segments,
    ViewingDirection=Vector(0, 1, 0),
    ViewingRange=Slider(16, range=0.1..16),
    ViewingAngle=360,
    Precision=360,
    ShowPolygon=True,
    ShowRadials=False,
    UseGPU=Toggle(False))  # -> IsovistPolygon, Radials, ObstacleVisibility, IsovistProperties

# ----
cull = CullPattern(List=cluster_8, CullPattern=invert(null.NullFlags))
crv_7 = Curve(flatten(cull))
extr_2 = Extrude(Base=crv_7, Direction=Z)
crv_8 = Curve(crv_7)
area_3 = Area(Geometry=crv_8)  # -> Area, Centroid
# Convert the box to Honeybee zone
# All the material will be set to default
# In case you want to change them search
# for Honeybee_Set Radiance Materials
# component.
cap = CapHoles(Brep=extr_2)
explode_7 = Explode(Curve=crv_8, Recursive=True)  # -> Segments, Vertices
points = PointList(Points=area_3.Centroid, Size=3)
move_3 = Move(Geometry=area_3.Centroid, Motion=Z)  # -> Geometry, Transform
item_10 = ListItem(List=explode_7.Vertices, Index=3, Wrap=True)
item_11 = ListItem(List=explode_7.Segments, Index=0, Wrap=True)
lnpt = LinePt(Line=item_11, Point=item_10)
merge_2 = Merge(Data1=simplify(graft(move_3.Geometry)), Data2=simplify(graft(crv_8)))
bbox = BoundingBox(Content=merge_2, Plane=lnpt, UnionBox=True)  # -> Box, Box_2
mass2zone = Honeybee_Masses2Zones(zoneMasses=flatten(cap), isConditioned=True, maxRoofAngle=30, createHBZones=run_solar_analysis)  # -> readMe, HBZones; plug-in component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
crv_9 = Curve(cull)
null_2 = NullItem(Item=crv_9)  # -> NullFlags, InvalidFlags, Description
cull_2 = CullPattern(List=crv_9, CullPattern=invert(null_2.NullFlags))
pcol = PolylineCollapse(Polyline=cull_2, Tolerance=Slider(0.9, range=0.3..2))  # -> Polyline, Count

# ---- group: Potential locker positions
cluster_9 = Cluster_12(G=cluster_6)

# ----
swatch = ColourSwatch(SwatchColor=RGBA(0, 128, 255, 93))
crv_cp_2 = CurveClosestPoint(Point=cp.ClosestPoint, Curve=pcol.Polyline)  # -> Point, graft(Parameter), Distance
cluster_10 = Cluster_5(P=item_9)

# ----
# Create ground in front of the room
# for more accurate analysis
crv_10 = Curve(cluster_10)
offcrv_4 = OffsetCurve(Curve=crv_10, Plane=PlaneXY(0, 0, 0), Distance=-3, BothSides=False, Kinks=0, CapType=1)
boundary_6 = BoundarySurfaces(Edges=flatten([offcrv_4, crv_10]))
createhbsrfs = Honeybee_createHBSrfs(geometry=boundary_6)  # -> readMe, simplify(HBSurface); plug-in component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

window_spacing = Slider(2.8, range=2..10)
window_width = Slider(1.352, range=0..10)
window_height = Slider(1.352, range=0..10)
preview = CustomPreview(Geometry=isovist.IsovistPolygon, Material=swatch)
dam = DataDam(
    DataA=isovist.IsovistPolygon,
    DataB=isovist.ObstacleVisibility,
    DataC=isovist.IsovistProperties,
    BufferDelay=10000000,
    BufferMode=0)  # -> DataA, DataB, DataC
item_12 = ListItem(List=dam.DataC, Index=occlusivity, Wrap=True)  # disabled
tag_2 = TextTag(Location=graft(rdpoints.OutPoint), Text=item_12)  # disabled
neg_2 = Negative(Value=corridor_width)

# ---- group: Group Cohesion / change to max of set
number_slider_4 = Slider(1000, range=0..1000)

# ---- group: Group Cohesion
len = Length(Curve=bang.Branch4)
ma = MassAddition(Input=len)  # -> Result, PartialResults
division_2 = Division(A=ma.Result, B=number_slider_4)

# ----
bbox_2 = BoundingBox(Content=flatten(crv), Plane=PlaneXY(0, 0, 0), UnionBox=True)  # -> Box, Box_2

# ---- group: Navigation Checkponts Visable
crv_11 = Curve(isovist.IsovistPolygon)
incurve = PointInCurve(Point=rdpoints.OutPoint, Curve=graft(crv_11))  # -> Relationship, Point
equals = Equality(FirstNumber=2, SecondNumber=incurve.Relationship)  # -> Equality, Inequality
ma_2 = MassAddition(Input=equals.Equality)  # -> Result, PartialResults
division_3 = Division(A=ma_2.Result, B=sqr)
avr_2 = Average(Input=division_3)

# ----
good_vent_treshold = Slider(0.05, range=0..1)

# ---- group: % Identifiable surfaces visable / mostly visible by
flip = FlipMatrix(Data=dam.DataB)

# ----
cluster_11 = Cluster_4(C=cull_2, t=crv_cp_2.Parameter, D=neg_2)  # -> L, C_2, i
cluster_12 = Cluster_10(C=pcol.Polyline, t=crv_cp_2.Parameter)  # -> L, C_2, i
area_4 = Area(Geometry=bbox_2.Box)  # -> Area, Centroid
Z_4 = UnitZ(Factor=Slider(60500, range=0..500000))
python_4 = GhPythonScript(bbox=bbox_2.Box)  # -> out, a; inputs bbox: GeometryBase
# ---------- python_4: Python ----------
__author__ = "kane"
__version__ = "2020.06.10"

import Rhino as rc

bbox = bbox.GetBoundingBox(True)
view = rc.RhinoDoc.ActiveDoc.Views.ActiveView
view.ActiveViewport.ZoomBoundingBox(bbox)
view.Redraw()
# ---------- end python_4 ----------
cluster_13 = Cluster_2(B=window_spacing, C=cluster_10, A=window_width, B_2=window_height, crv=cull)  # -> pl, R, L, R_2
data_3 = Data(cluster_13.R_2)
smaller = SmallerThan(FirstNumber=data_3, SecondNumber="0.95")  # -> SmallerThan, OrEqualTo
multiplication = Multiplication(A=data_3, B=smaller.SmallerThan)
# Add glazing based on percentage
# In case you want to add custom windows
# use Honeybee_addHBGlz component.
glazingcreator = Honeybee_GlazingBasedOnRatio(HBObjects=simplify(graft(mass2zone.HBZones)), glzRatio=multiplication, runIt=run_solar_analysis)  # -> readMe, HBObjWGLZ; plug-in component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
brep = Brep(flatten(glazingcreator.HBObjWGLZ))

# ---- group: HB Zone With Glazing
brep_2 = Brep(brep)

# ----
genhbzonetestpts = Honeybee_GenerateZoneTestPoints(HBZone=brep_2, gridSize=Slider(2, range=0..2), distBaseSrf=Slider(0.762, range=0..1), moveTestMesh=Toggle(True))  # -> readMe, simplify(testPoints), simplify(ptsVectors), simplify(facesArea), simplify(mesh); plug-in component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
wires = BrepWireframe(Brep=brep_2, Density=-1)
# Put the recipie together!
gridbasedsimulation = Honeybee_GridBasedSimulation(
    skyFile=genclimatebasedsky.skyFilePath,
    testPoints=genhbzonetestpts.testPoints,
    ptsVectors=genhbzonetestpts.ptsVectors,
    simulationType=0)  # -> analysisRecipe; plug-in component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
# Run the analysis
rundaylightanalysis = Honeybee_RunDaylightSimulation(
    HBObjects=flatten([brep_2, createhbsrfs.HBSurface]),
    analysisRecipe=gridbasedsimulation,
    writeRad=run_solar_analysis,
    runRad=run_solar_analysis,
    numOfCPUs="7",
    overwriteResults=True)  # -> readMe, analysisType, resultsUnit, results, testPts, resultFiles, radGeoFile, studyFolder, done; plug-in component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
list_length = ListLength(List=genhbzonetestpts.testPoints)
partition_list = PartitionList(List=rundaylightanalysis.results, Size=list_length)
path_mapper = PathMapper(partition_list, source="{A;B}(i)", target="{A;i}(B)")
number = Number(path_mapper)

adequete_lighting_threashold = Slider(400, range=0..1000)
larger = LargerThan(FirstNumber=rundaylightanalysis.results, SecondNumber=adequete_lighting_threashold)  # -> LargerThan, OrEqualTo
ma_3 = MassAddition(Input=flatten(larger.LargerThan))  # -> Result, PartialResults
lng_6 = ListLength(List=flatten(larger.LargerThan))
division_4 = Division(A=ma_3.Result, B=lng_6)

average = Average(Input=number)
shift_paths = ShiftPaths(Data=average, Offset=-1)
mjoin = MeshJoin(Meshes=flatten(genhbzonetestpts.mesh))

# ---- group: % Identifiable surfaces visable
ma_4 = MassAddition(Input=flip)  # -> Result, PartialResults
bnd_2 = Bounds(Numbers=flatten(ma_4.Result))
remap = RemapNumbers(Value=ma_4.Result, Source=bnd_2, Target=Domain(0, 1))  # -> Mapped, Clipped
ma_5 = MassAddition(Input=flatten(remap.Mapped))  # -> Result, PartialResults
division_5 = Division(A=ma_5.Result, B=lng_5)

# ----
move_4 = Move(Geometry=area_4.Centroid, Motion=Z_4)  # -> Geometry, Transform
item_13 = ListItem(List=isovist.IsovistPolygon, Index="0", Wrap=True)
cluster_14 = Cluster_3(data=cluster_12.i, wall_width=wall_thickness, C=cluster_12.C_2)
branch = TreeBranch(Tree=simplify(equals.Equality), Path="0", MaintainPaths=True)
subtraction = Subtraction(A=1, B=division_2)
swatch_2 = ColourSwatch(SwatchColor=RGB(0, 0, 0))
open_space_calculation = OpenSpaceCalculation(G=cluster_10, L=lnpt)  # -> S, openpercent, builtpercent

# ---- group: All Points
point_3 = Point(rdpoints.OutPoint)

# ----
cull_3 = CullPattern(List=rdpoints.OutPoint, CullPattern=equals.Equality)

# ---- group: Navigation Paths
curve = Curve(rdlines_2.OutLine)

# ---- group: Navigation Corridors
surface = Surface(boundary_5)

# ----
python_5 = GhPythonScript(value=cluster_13.R, target=good_vent_treshold)  # -> out, a, quality; inputs value: list
# ---------- python_5: Python ----------
a = []
for v in value:
    if v > target:
        a.append(1)
    else:
        a.append(v/target)
        
quality = sum(a)/len(value)
# ---------- end python_5 ----------

# ---- group: Clean corners
join = JoinCurves(Curves=flatten(trim.Inside), Preserve=False)
disc_3 = Discontinuity(Curve=join, Level=1)  # -> flatten(Points), Parameters
rdpoints_2 = RemoveDuplicatePointsKaramba3D(Point=disc_3.Points, LimitDistance=0.005)  # -> OutPoint, Info, Indexes
cp_3 = ClosestPoint(Point=rdpoints_2.OutPoint, Cloud=point_3)  # -> ClosestPoint, CPIndex, Distance
rdpoints_3 = RemoveDuplicatePointsKaramba3D(Point=cp_3.ClosestPoint, LimitDistance=0.005)  # -> OutPoint, Info, Indexes

# ----
Z_5 = UnitZ(Factor=1)
lng_7 = ListLength(List=cull_3)
move_5 = Move(Geometry=rdpoints.OutPoint, Motion=Z_5)  # -> Geometry, Transform
dots = DotDisplay(Point=move_5.Geometry, Colour=swatch, Size=swatch_2)
pt_3 = Point(Point(27.83187543, 45.15124813, 0))
circle = CircleCNR(Center=point_2, Normal=Vector(0, 0, 1), Radius=0.5)
ma_6 = MassAddition(Input=flatten(lng_7))  # -> Result, PartialResults
tag_3 = TextTag(Location=graft(move_5.Geometry), Text=lng_7, Colour=ColourSwatch(SwatchColor=RGB(255, 255, 255)))
format = Format(Format="Total Visibility Score: {0}", Culture=127, Data0=ma_6.Result)
tag_4 = TextTag3D(Location=pt_3, Text=format, Size=1, Colour=swatch_2, Justification=7)
number_slider_5 = Slider(4, range=1..6)

# ---- group: show the effect of one
point_4 = Point(Point(63.56625161, 62.70267922, 0))

# ----
point_5 = Point(<point referenced from the Rhino model>)
explode_8 = Explode(Curve=cluster_6, Recursive=True)  # -> flatten(Segments), Vertices
vd = ViewingDirection(Vector(0, 1, 0))
hall_index = Panel("15")
cluster_15 = Cluster_11(C=item_9, T=crv, P=hall_index)  # -> C_2, arithmetic_mean

# ---- group: Starting Point
closest_point = ClosestPoint(Point=cluster_15.arithmetic_mean, Cloud=point_2)  # -> ClosestPoint, CPIndex, Distance

# ----
circle_2 = CircleCNR(Center=closest_point.ClosestPoint, Normal=Vector(0, 0, 1), Radius=0.4)

# ---- group: All Other Points
cull_index = CullIndex(List=point_2, Indices=closest_point.CPIndex, Wrap=True)

# ----
circle_cnr = CircleCNR(Center=closest_point.ClosestPoint, Normal=Vector(0, 0, 1), Radius=0.5)
merge_3 = Merge(Data1=point_4, Data2=flatten(cull_index), Data3=point_5)

# ---- group: depth first search
ghpython_script = GhPythonScript(
    start_pt=closest_point.ClosestPoint,
    viz_pt=cull_index,
    nav_pt=rdpoints_3.OutPoint,
    OL=explode_8.Segments,
    VR=viewing_range,
    VD=vd,
    step_limit=number_slider_5)  # -> out, cnt, simplify(pl), vpts; inputs start_pt: Point3d, viz_pt: list of Point3d, nav_pt: list of Point3d, OL: list of Line, VR: Int32, VD: Vector3d, step_limit: Int32; disabled
# ---------- ghpython_script: Python ----------
import ghpythonlib.components as ghcomp
import copy
import ghpythonlib.treehelpers as th

Global_check = 0
Step_Limit = step_limit

def ensure_list(lst):
    if not isinstance(lst, list):
        return [lst]
    else:
        return lst

def traverse(pt, allptlist, ptlist, counter = 0, pl = [], step = 0, vpts=[]):
    if step >= Step_Limit:
        #print "Reached Limit"
        yield counter, pl, vpts
    else:
        pl.append(pt)
        ptlist = copy.deepcopy(ptlist) # make a copy so not to change for other branches.
        vpts = copy.deepcopy(vpts)
        new_step = step+1
        # generate isovist with global settings and obstacles
        isovist = ghcomp.DecodingSpacesAssembly.Isovist(pt, OL, VD, VR, 360, 360, True, False, False)[0]
        # check what isovist areas encapsulate points
        viewable_pts = []#viewable pts not already viewed
        #pl.append(pt) #Add last nav checkpoint for later debug or viz
        points_visible = ensure_list(ghcomp.PointInCurve(ptlist , isovist)[0])
        #reversed_points_visible = points_visible[::-1]
        vpts_buf=[""]
        for i, test in reversed(list(enumerate(points_visible))): 
            if test == 2: #if inside
                counter += 1 #global counter increment
                vpts_buf.append(ptlist.pop(i))
                 # remove the observed point to prevent double counting
        vpts.append(vpts_buf)
        #print points_visible
        total = len(points_visible)-1
        #print "total:", total
        #print len(allptlist)
        nav_pts_ind = ensure_list(ghcomp.ClosestPoints(pt,allptlist,3)[1])
        nav_pts_ind.sort()
        print nav_pts_ind, len(allptlist)
        #print "K", nav_pts_ind, "Total all ptlist: ", len(allptlist)
        for i, nav_pt_ind in reversed(list(enumerate(nav_pts_ind))):
            pl = copy.deepcopy(pl) 
            #Update point list
            if nav_pt_ind is not None:
                try:
                    print nav_pt_ind, len(allptlist)
                    if nav_pt_ind < len(allptlist):
                        nav_pt = allptlist.pop(nav_pt_ind)# remove nav point used
                        #if len(allptlist) == 0:
                        #    raise
                        print new_step
                        for part in traverse(nav_pt, allptlist, ptlist, counter = counter, pl = pl, step = new_step, vpts=vpts):
                            yield part
                    else:
                        #Nested loops already removed points to cull?
                        print "LARGER"
                except:
                    print "EXCEPT"
                    #print "nav point already used by parallel operation", len(allptlist), " | ", nav_pts_ind
                    nav_pt_ind_alt = ghcomp.ClosestPoints(pt,allptlist,1)[1]
                    if nav_pt_ind_alt == None:
                        raise
                    nav_pt = allptlist.pop(nav_pt_ind_alt)
    
                    if len(allptlist) == 0:
                        raise
                    for part in traverse(nav_pt, allptlist, ptlist, counter = counter, pl = pl, step = new_step, vpts=vpts):
                        yield part

counts, polylines, vizpts = [], [], []
#print(list(list(traverse(start_pt, nav_pt))[0]))

for branch in list(traverse(start_pt, nav_pt, viz_pt,0, [])):
    counts.append(branch[0])
    polylines.append(branch[1])
    vizpts.append(branch[2])

cnt,pl,vpts = th.list_to_tree(counts, None), th.list_to_tree(polylines, None), th.list_to_tree(vizpts, None)#min(counts)
# ---------- end ghpython_script ----------

# ---- group: breadth first search
ghpython_script_2 = GhPythonScript(
    start_pt=closest_point.ClosestPoint,
    viz_pt=cull_index,
    nav_pt=rdpoints_3.OutPoint,
    OL=explode_8.Segments,
    VR=viewing_range,
    VD=vd,
    step_limit=number_slider_5)  # -> out, cnt, simplify(pl), vpts; inputs start_pt: Point3d, viz_pt: list of Point3d, nav_pt: list of Point3d, OL: list of Line, VR: Int32, VD: Vector3d, step_limit: Int32
# ---------- ghpython_script_2: Python ----------
import ghpythonlib.components as ghcomp
import copy
import ghpythonlib.treehelpers as th
import Rhino.Geometry as rg
import math
Global_check = 0
Step_Limit = step_limit

def ensure_list(lst):
    if not isinstance(lst, list):
        return [lst]
    else:
        return lst

def bfs_connected_component(graph, start):
    # keep track of all visited nodes
    explored = []
    # keep track of nodes to be checked
    queue = [start]
 
    # keep looping until there are nodes still to be checked
    while queue:
        # pop shallowest node (first node) from queue
        node = queue.pop(0)
        if node not in explored:
            # add node to list of checked nodes
            explored.append(node)
            neighbours = graph[node]
 
            # add neighbours of node to queue
            for neighbour in neighbours:
                queue.append(neighbour)
    return explored
 
#bfs_connected_component(graph,'A') # returns ['A', 'B', 'C', 'E', 'D', 'F', 'G']

def traverse(start, allptlist, ptlist):
    # keep track of step
    gstep = 0
    step = 0
    # keep track of number of visited nodes
    counter = 0
    # keep track of last pl
    pl = [[]]
    ii=0
    # keep track of all visited nav nodes
    explored = []
    # keep track of all visible viz nodes
    viewed = []
    # keep track of nodes to be checked
    queue = [start]
    
    while queue:
        #print len(queue)
        # pop shallowest node (first node) from queue
        if gstep == 0: # Ignore first step
            pass
        else:
            #print "STOP TEST: ", math.log(gstep)/math.log(3)
            if math.log(gstep)/math.log(3) >= step_limit:
                break
        node = queue.pop(0)

        #if len(queue)==0:
        ii=0
        if node not in explored:
            # add node to list of checked nodes
            last_pl=copy.deepcopy(pl[ii])
            last_pl.append(node)
            pl[ii] = last_pl
            explored.append(node)
            # generate isovist with global settings and obstacles
            isovist = ghcomp.DecodingSpacesAssembly.Isovist(node, OL, VD, VR, 360, 360, True, False, False)[0]
            point_relationship = ensure_list(ghcomp.PointInCurve(ptlist , isovist)[0])
            viewed.append([])
            for i, test in reversed(list(enumerate(point_relationship))): 
                if test == 2: #if inside
                    counter += 1 #global counter increment
                    #remove vizible point
                    pt_visible = ptlist.pop(i)
                    viewed[-1].append(pt_visible)
            
            closest_nodes = ghcomp.ClosestPoints(node,allptlist,3)
            nav_pts_ind = ensure_list(closest_nodes[1])
            #Add next iter to queue and add step
            gstep+=3
            queue.extend(ensure_list(closest_nodes[0]))
            #print queue
            
            
            nav_pts_ind.sort()
            for i, nav_pt_ind in reversed(list(enumerate(nav_pts_ind))):
                #remove nav pt from global list
                if nav_pt_ind is not None:
                    allptlist.pop(nav_pt_ind)


    return counter, th.list_to_tree(explored, None), th.list_to_tree(viewed, None)



cnt,pl,vpts = traverse(start_pt, nav_pt, viz_pt)
# ---------- end ghpython_script_2 ----------

# ---- group: Vizibility
sort_2 = SortList(Keys=ghpython_script_2.cnt)  # -> reverse(Keys), ValuesA
item_14 = ListItem(List=sort_2.Keys, Index=0, Wrap=True)
lng_8 = ListLength(List=cull_index)
# def bfs_connected_component(graph, start):
#     # keep track of all visited nodes
#     explored = []
#     # keep track of nodes to be checked
#     queue = [start]
# 
#     # keep looping until there are nodes still to be checked
#     while queue:
#         # pop shallowest node (first node) from queue
#         node = queue.pop(0)
#         if node not in explored:
#             # add node to list of checked nodes
#             explored.append(node)
#             neighbours = graph[node]
# 
#             # add neighbours of node to queue
#             for neighbour in neighbours:
#                 queue.append(neighbour)
#     return explored
# 
# bfs_connected_component(graph,'A') # returns ['A', 'B', 'C', 'E', 'D', 'F', 'G']
division_6 = Division(A=ghpython_script_2.cnt, B=lng_8)

# ----
cluster_16 = Cluster_13(crv=explode_6.Segments, num=viewing_range, pt=closest_point.ClosestPoint, pt_2=cull_index, vd=vd)  # disabled

# ---- group: Display Control Center
wiredisplay = ControlWireDisplay(WireDisplay="2", AllObjects_Object=[tag_5, previewlw, previewlw_2, previewlw_4, previewlw_5, previewlw_3, preview_2])
swatch_3 = ColourSwatch(SwatchColor=RGB(0, 0, 0))
swatch_4 = ColourSwatch(SwatchColor=RGB(163, 155, 135))
swatch_5 = ColourSwatch(SwatchColor=RGB(217, 198, 152))
tag_5 = TextTag(Location=flatten(pcen_2.CenterE), Text=python_2.name, Colour=ColourSwatch(SwatchColor=RGB(0, 0, 0)))
preview_2 = CustomPreview(Geometry=open_space_calculation.S, Material=graft(ColourSwatch(SwatchColor=RGB(134, 156, 124))))
preview_3 = CustomPreview(Geometry=cluster_9, Material=ColourSwatch(SwatchColor=RGB(230, 230, 230)))
preview_4 = CustomPreview(Geometry=cluster_15.C_2, Material=ColourSwatch(SwatchColor=RGB(255, 0, 0)))
previewlw = CustomPreviewLineweights(
    Geometry=bang.Branch3,
    Shader=ColourSwatch(SwatchColor=RGB(0, 0, 255)),
    Thickness=Slider(0.1, range=0..0.1),
    Absolute=False)
previewlw_2 = CustomPreviewLineweights(
    Geometry=bang.Branch4,
    Shader=ColourSwatch(SwatchColor=RGB(255, 0, 0)),
    Thickness=Slider(0.1, range=0..0.1),
    Absolute=False)
previewlw_3 = CustomPreviewLineweights(
    Geometry=cluster_13.pl,
    Shader=ColourSwatch(SwatchColor=RGB(0, 149, 255)),
    Thickness=Slider(6, range=0..10),
    Absolute=False)
previewlw_4 = CustomPreviewLineweights(
    Geometry=[rdlines_2.OutLine, cluster_12.L],
    Shader=ColourSwatch(SwatchColor=RGB(255, 0, 0)),
    Thickness=Slider(3.55, range=0..4),
    Absolute=False)
previewlw_5 = CustomPreviewLineweights(Geometry=cluster_14, Shader=ColourSwatch(SwatchColor=RGB(60, 255, 0)), Thickness=Slider(4, range=0..4), Absolute=False)

# ----
old_wayfinding = Panel(cluster_16)
preview_5 = CustomPreview(Geometry=boundary_4, Material=graft(swatch_3))
preview_6 = CustomPreview(Geometry=boundary_3, Material=graft(swatch_3))
preview_7 = CustomPreview(Geometry=boundary_5, Material=graft(swatch_4))
preview_8 = CustomPreview(Geometry=boundary_2, Material=graft(swatch_5))
save_layout_data = Button()
toggle = BooleanToggle(True)
toggle_2 = BooleanToggle(True)

# ---- group: Reset at the start so that we start from Zero
button = Button()

# ----
path = FilePath("C:\Users\kane\Documents\GitHub\HVM_Generative\")
panel_5 = Panel(path)

# ----
# Visualize the results
number_slider_6 = Slider(1, range=0..10)
gradientlibrary = Ladybug_GradientLibrary(gradIndex=number_slider_6)  # -> customColors; plug-in component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
legendpar = Ladybug_LegendParameters(
    lowBound=Slider(100, range=0..100),
    highBound=Slider(1000, range=0..1000),
    numSegments=Slider(6, range=0..10),
    customColors=flatten(gradientlibrary))  # -> legendPar; plug-in component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

# ---- group: make it 3D!
dom = ConstructDomain(DomainStart=0, DomainEnd=Slider(1, range=0..1))

# ----
recolormesh = Ladybug_RecolorMesh(
    analysisResult=flatten(shift_paths),
    inputMesh=flatten(mjoin),
    heightDomain=dom,
    legendPar=legendpar,
    analysisTitle=rundaylightanalysis.analysisType,
    legendTitle=rundaylightanalysis.resultsUnit)  # -> readMe, newMesh, newLegend, legendBasePt, meshColors, legendColors; plug-in component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

# ---- group: New visibility calc
list_item = ListItem(List=dam.DataC, Index=0, Wrap=True)  # -> flatten(Item)

# ---- group: New visibility calc / unitize visibility
evaluate = Evaluate(Expression="y/(π*x²)", x=viewing_range, y=list_item)

# ---- group: New visibility calc (continued)
avr_3 = Average(Input=evaluate)

# ---- group: KPIs
merge_4 = Merge(
    Data1=flatten(division_6),
    Data2=flatten(division_4),
    Data3=flatten(open_space_calculation.builtpercent),
    Data4=flatten(python_5.quality),
    Data5=flatten(subtraction),
    Data6=flatten(avr_3),
    Data7=flatten(open_space_calculation.openpercent))
# Wayfinding
# Natural Light
# Open Spaces
# Ventilation
# Grouping
# Visibility
# Built Up Space
nullrep = ReplaceNulls(Items=merge_4, Replacements=0)  # -> Items, Count
panel_6 = Panel(merge_4)

# ----
python_6 = GhPythonScript(trigger=save_layout_data, x=merge_4, reset=button)  # -> out, ready, counter; inputs x: list
# ---------- python_6: Python ----------
__author__ = "kane"
__version__ = "2020.05.29"

import scriptcontext as sc

if not sc.sticky.has_key('counter_sol'):
    sc.sticky['counter_sol'] = 0

if reset:
    sc.sticky['counter_sol'] = 0
elif trigger == True:
    sc.sticky['counter_sol'] += 1

counter = sc.sticky['counter_sol'] 

ready = trigger
# ---------- end python_6 ----------
python_7 = GhPythonScript(
    dir_loc=path,
    stats=nullrep.Items,
    id=python_6.counter,
    bbox=bbox_2.Box,
    save_layout=python_6.ready,
    save_layout_image=python_6.ready,
    reset=button)  # -> out; inputs stats: list, bbox: GeometryBase, save_layout: Boolean, save_layout_image: Boolean
# ---------- python_7: Python ----------
__author__ = "GreenLayout"
__version__ = "2020.02.03"

import xml
import xml.etree.ElementTree as ET
from xml.etree.ElementTree import ElementTree
import re
import Rhino as rc
import scriptcontext
import rhinoscriptsyntax as rs
import Grasshopper.Kernel as gh
import os
import System
import random
import json
import time
from ghpythonlib import treehelpers as th
import locale
locale.setlocale(locale.LC_ALL, '') 

import scriptcontext as sc

if len(stats) != 7 and any([stat==None for stat in stats]): #verify that all stats are there
    w = gh.GH_RuntimeMessageLevel.Warning
    ghenv.Component.AddRuntimeMessage(w, "Check that all six stats are valid and not null.")
    stats = None 

if stats != None:
    gh_path = os.path.dirname(ghenv.Component.OnPingDocument().FilePath)

    def captureActiveViewToFile(width,height,path,grid,worldAxes,cplaneAxes):
        
        """
        Captures the active view to an image file at the path. Path looks like this:
        "C:\\Users\\kane\\Desktop\\Captures\\sdasd.png"
        """
        
        # Set the script context to the current Rhino doc
        sc.doc = rc.RhinoDoc.ActiveDoc
        
        # Get the active view and set image dimensions
        activeView = sc.doc.Views.ActiveView
        imageDim = System.Drawing.Size(width,height)
        # Perform the capture
        try:
            imageCap = rc.Display.RhinoView.CaptureToBitmap(activeView,imageDim,grid,worldAxes,cplaneAxes)
            System.Drawing.Bitmap.Save(imageCap,path)
            rc.RhinoApp.WriteLine(path)
            return path
        except:
            raise Exception(" Capture failed, check the path")
    
    def add_stat_to_xml(log_filename, stats):
        
        #Check if xml exists
        try:
            tree = ET.parse(gh_path + "/tmp/" + log_filename +".xml")
            if reset:
                raise Exception("resetting")
        except:
            #Assert folder structure exists
            if not os.path.exists(gh_path + "/tmp"):
                try:
                    os.mkdir(gh_path+"/tmp")
                    os.mkdir(gh_path+"/tmp/layout_imgs")
                except OSError:
                    print ("Creation of the directory %s failed" % gh_path+"/tmp")
                else:
                    print ("Successfully created the directory %s " % gh_path+"/tmp")
            #create a root
            #overwrite if id already exists return error
            Layouts = ET.Element('Layouts')
            tree = ElementTree(Layouts)
        
        #get root
        xmlRoot = tree.getroot()
        for ids in xmlRoot.findall("layout"):
            if ids.attrib['id'] == str(id):
                xmlRoot.remove(ids)
                
        #build element
        stats = [str(i) for i in stats]
        child = ET.Element('layout', id=str(id), obj1_Wayfinding=stats[0], obj2_Natural_Light=stats[1], obj3_Open_Spaces=stats[2], obj4_Ventilation=stats[3], obj5_Grouping=stats[4], obj6_Visibility=stats[5], obj7_Built_Up_Efficiency=stats[6])
        #add element
        xmlRoot.append(child)
        tree.write(gh_path + "/tmp/" + log_filename +".xml")

        w = gh.GH_RuntimeMessageLevel.Remark
        ghenv.Component.AddRuntimeMessage(w, "Wrinting objectives to file for layout %s." %id)
        

    
    ##Save Images##
    scriptcontext.doc = rc.RhinoDoc.ActiveDoc
    filepath = gh_path+"/tmp/layout_imgs/"
    try:
        if not os.path.exists(filepath):
            os.mkdir(filepath)
    except OSError:
        print ("Creation of the directory %s failed" % filepath)
    if save_layout:
        add_stat_to_xml("logfile", stats)
    if save_layout_image:
        
        #If named view named top does not exists create it based on top.
        #rs.RestoreNamedView("Top")
        #ZoomSelected
        #bbox = bbox.GetBoundingBox(True)
        #view = rc.RhinoDoc.ActiveDoc.Views.ActiveView
        #view.ActiveViewport.ZoomBoundingBox(bbox)
        #view.Redraw()
        
        #rs.ZoomBoundingBox(bounding_box=bbox, all=True) #view="Top"
        captureActiveViewToFile(2000,2000,filepath+str(id)+".png",None,None,None)
# ---------- end python_7 ----------
data_4 = Data(python_6.counter)
num_2 = Number(merge_4)
panel_7 = Panel(python_6.counter)

# ==== cluster Cluster
A = ClusterInput()
concat = Concatenate(FragmentA=A, FragmentB="\Elements_Groups.xlsx")
panel = Panel("Sheet1")
excelread = ExcelReader(ReadExcelData=Toggle(False), WorkbookPath=concat, WorksheetName="Sheet1", DataStruct=False)  # -> Exceptions, ExcelData, ExcelData_2
data = Data(Tree({0}: ["Room ID", "0", "1", "2", "3", "4", "5", "6", "7"], {1}: ["Room Description", "Class Room", "Faculty Office", "Department Office", "Research Scholar Lab", "Faculty Rest Room", "Conference Room", "Common Rest Room", "Computer Lab"], {2}: ["Ideal Side Length A", "8", "4", "4", "8", "2", "4", "4", "8"], {3}: ["Ideal Side Length  B", "15", "4.5", "5", "11.25", "2", "5", "5", "11.25"], {4}: ["Area (each)", "120", "18", "20", "90", "4", "20", "20", "90"], {5}: ["Height", "4", "4", "4", "4", "4", "4", "4", "4"], {6}: ["Group ID", "1", "0", "2", "3", "0", "2", "4", "3"], {7}: ["Group Description", "Class Group", "Faculty Group", "Office Group", "Lab Group", "Faculty Group", "Office Group", "Rest Room Group", "Lab Group"], {8}: ["Number in Group", "1", "6", "1", "1", "2", "1", "2", "1"]))
data_2 = Data(Tree({0}: ["Room ID", "0", "1", "2", "3", "4", "5", "6", "7", "8"], {1}: ["Room Description", "Class Room", "Faculty Office", "Department Office", "Research Scholar Lab", "Faculty Rest Room", "Conference Room", "Common Rest Room", "Computer Lab", "Hall"], {2}: ["Ideal Side Length A", "8", "4", "4", "8", "2", "4", "4", "8", "8"], {3}: ["Ideal Side Length  B", "15", "4.5", "5", "11.25", "2", "5", "5", "11.25", "8"], {4}: ["Area (each)", "120", "18", "20", "90", "4", "20", "20", "90", "64"], {5}: ["Height", "4", "4", "4", "4", "4", "4", "4", "4", "4"], {6}: ["Group ID", "1", "0", "2", "3", "0", "2", "4", "3", "5"], {7}: ["Group Description", "Class Group", "Faculty Group", "Office Group", "Lab Group", "Faculty Group", "Office Group", "Rest Room Group", "Lab Group", "Entrance Group"], {8}: ["Number in Group", "1", "6", "1", "1", "2", "1", "2", "1", "1"]))
cull_i = CullIndex(List=data_2, Indices="0", Wrap=True)
L = ClusterOutput(cull_i)

# ==== cluster Cluster_2
crv = ClusterInput()
crv_2 = Curve(crv)
B = ClusterInput()
C = ClusterInput()
crv_3 = Curve(reparameterize(crv))
A = ClusterInput()

# ---- group: Window Geo
disc = Discontinuity(Curve=C, Level=1)  # -> Points, Parameters
crv_4 = Curve(C)
pline = PolyLine(Vertices=disc.Points, Closed=True)
explode = Explode(Curve=pline, Recursive=True)  # -> Segments, Vertices
len = Length(Curve=explode.Segments)
division = Division(A=len, B=B)
round = Round(Number=division)  # -> Nearest, Floor, Ceiling
multiplication = Multiplication(A=round.Floor, B=2)
divide = DivideCurve(Curve=explode.Segments, Count=multiplication, Kinks=False)  # -> Points, Tangents, Parameters
cull = CullPattern(List=divide.Points, CullPattern=[False, True])
cull_2 = CullPattern(List=divide.Parameters, CullPattern=[False, True])  # -> simplify(graft(List))
pshift = ShiftPaths(Data=cull_2, Offset=-1)
division_2 = Division(A=A, B=2)
neg = Negative(Value=division_2)
lng = ListLength(List=pshift)
dup = DuplicateData(Data=simplify(graft(explode.Segments)), Number=lng, Order=True)  # -> simplify(graft(Data))
merge = Merge(Data1=neg, Data2=division_2)
clean = CleanParallel(PrimaryData=cull_2, SecondaryData1=dup, removeEmpty=True)  # -> PrimaryData, SecondaryData1
addition = Addition(A=<missing>, B=merge)  # -> simplify(Result)
eval = EvaluateCurve(Curve=<missing>, Parameter=addition)  # -> Point, Tangent, Angle
pline_2 = PolyLine(Vertices=eval.Point, Closed=False)

# ---- group: how many windows in room
tolerance = Panel("0.01")
crv_cp = CurveClosestPoint(Point=flatten(cull), Curve=graft(crv_3))  # -> Point, Parameter, Distance
smaller = SmallerThan(FirstNumber=crv_cp.Distance, SecondNumber=tolerance)  # -> SmallerThan, OrEqualTo
cull_3 = CullPattern(List=crv_cp.Parameter, CullPattern=smaller.SmallerThan)  # -> simplify(List)
lng_2 = ListLength(List=cull_3)

# ----
B_2 = ClusterInput()
disc_2 = Discontinuity(Curve=crv_3, Level=1)  # -> Points, simplify(Parameters)

# ---- group: Area of 1 window
multiplication_2 = Multiplication(A=A, B=B_2)

# ----
cull_4 = CullPattern(List=crv_cp.Point, CullPattern=smaller.SmallerThan)
L = ClusterOutput(cull_4)
eval_2 = EvaluateCurve(Curve=graft(crv_3), Parameter=cull_3)  # -> Point, Tangent, Angle

# ---- group: Window orientation
xy_plane = XYPlane(Origin=eval_2.Point)
rotate = Rotate(Vector=eval_2.Tangent, Axis=xy_plane, Angle=1.570796327)
vector_display = VectorDisplay(Anchor=xy_plane, Vector=rotate)

# ----
branch = TreeBranch(Tree=simplify(eval_2.Point), Path="{0}", MaintainPaths=True)
pl = ClusterOutput(pline_2)

# ---- group: SS Version of Ventilation Calc
crossref = CrossReference(ListA=eval_2.Tangent, ListB=eval_2.Tangent, CrossMode=5)  # -> ListA, ListB
angle = Angle(VectorA=crossref.ListA, VectorB=crossref.ListB)  # -> Angle, Reflex
ma = MassAddition(Input=angle.Angle)  # -> Result, PartialResults
pi = Pi(Factor=1)
division_3 = Division(A=ma.Result, B=pi)  # -> flatten(Result)
nullrep = ReplaceNulls(Items=division_3, Replacements=0)  # -> Items, Count

# ---- group: New Logic For Ventilation / ideal orientation for ventilation = 1
unit_x = UnitX(Factor=1)
reverse = Reverse(Vector=unit_x)

# ---- group: New Logic For Ventilation
angle_2 = Angle(VectorA=reverse, VectorB=rotate)  # -> Angle, Reflex
angle_3 = Angle(VectorA=unit_x, VectorB=rotate)  # -> Angle, Reflex
minimum = Minimum(A=angle_2.Angle, B=angle_3.Angle)
mapped_to = Panel("1 To 0")
remap_numbers = RemapNumbers(Value=minimum, Source="0 To Pi/2", Target=mapped_to)  # -> Mapped, Clipped
area = Area(Geometry=crv_3)  # -> Area, Centroid
average = Average(Input=remap_numbers.Clipped)  # -> flatten(ArithmeticMean)
nullrep_2 = ReplaceNulls(Items=average, Replacements=0)  # -> Items, Count

# ----
window_ventilation_logic = Panel("1")
ma_2 = MassAddition(Input=remap_numbers.Clipped)  # -> flatten(Result), PartialResults
nullrep_3 = ReplaceNulls(Items=ma_2.Result, Replacements=0)  # -> Items, Count
panel = Panel(remap_numbers.Clipped)
panel_2 = Panel(ma_2.Result)
stream_filter = StreamFilter(Gate=window_ventilation_logic, Stream0=nullrep.Items, Stream1=nullrep_3.Items)

# ---- group: divide by size of room
division_4 = Division(A=stream_filter, B=area.Area)  # -> flatten(Result)

# ----
R = ClusterOutput(division_4)
tag = TextTag(Location=cull, Text=graft(round.Floor))  # disabled
tag_2 = TextTag(Location=area.Centroid, Text=division_4)  # disabled

# ---- group: glazing Ratio
shatter = Shatter(Curve=graft(crv_3), Parameters=disc_2.Parameters)  # -> simplify(Segments)
ins = InsertItems(List=disc_2.Parameters, Item=1, Indices=-1, Wrap=True)
shift = ShiftList(List=ins, Shift=1, Wrap=False)
dom = ConstructDomain(DomainStart=disc_2.Parameters, DomainEnd=shift)  # -> simplify(Domain)
lng_3 = ListLength(List=dom)
dup_2 = DuplicateData(Data=cull_3, Number=lng_3, Order=True)  # -> simplify(Data)
lng_4 = ListLength(List=cull_3)
partition = PartitionList(List=simplify(dup_2), Size=lng_4)  # -> simplify(Chunks)
inc = Includes(Value=partition, Domain=graft(dom))  # -> Includes, Deviation
ma_3 = MassAddition(Input=inc.Includes)  # -> Result, PartialResults
height = Panel("3.5")
len_2 = Length(Curve=shatter)
midpt = CurveMiddle(Curve=shatter)
pshift_2 = ShiftPaths(Data=ma_3.Result, Offset=-1)
multiplication_3 = Multiplication(A=pshift_2, B=multiplication_2)
multiplication_4 = Multiplication(A=len_2, B=height)

# ----
tstat = TreeStatistics(Tree=multiplication_3)  # -> Paths, Length, Count
branch_2 = TreeBranch(Tree=multiplication_4, Path=tstat.Paths, MaintainPaths=True)

# ---- group: glazing Ratio (continued)
division_5 = Division(A=multiplication_3, B=branch_2)

# ----
R_2 = ClusterOutput(division_5)
tag_3 = TextTag(Location=midpt, Text=pshift_2)  # disabled

# ==== cluster Cluster_3
C = ClusterInput()
data = ClusterInput()
area = Area(Geometry=C)  # -> Area, Centroid
data_2 = Data(data)
smaller = SmallerThan(FirstNumber=area.Area, SecondNumber="1")  # -> SmallerThan, OrEqualTo
wall_width = ClusterInput()

# ----
# Connected to outside
# Surrounded by Corridors + Must have skylights
# if distance == 0 gets both walls from corner, how to select the correct one?
explode = Explode(Curve=C, Recursive=True)  # -> Segments, Vertices
lng = ListLength(List=explode.Segments)
crv_cp = CurveClosestPoint(Point=data_2, Curve=explode.Segments)  # -> Point, Parameter, Distance
series = Series(Start=0, Step=1, Count=lng)  # -> simplify(Series)
equals = Equality(FirstNumber=0, SecondNumber=crv_cp.Distance)  # -> Equality, Inequality
sort = SortList(Keys=crv_cp.Distance, ValuesA=crv_cp.Point, ValuesB=crv_cp.Parameter, ValuesC=series)  # -> Keys, ValuesA, ValuesB, ValuesC
cull = CullPattern(List=series, CullPattern=equals.Equality)
item = ListItem(List=sort.ValuesC, Index=0, Wrap=True)
item_2 = ListItem(List=explode.Segments, Index=cull, Wrap=True)
pt = Point(data_2)
item_3 = ListItem(List=explode.Segments, Index=item, Wrap=True)
midpt = CurveMiddle(Curve=item_2)
python = GhPythonScript(door_width="0.9", placement=flatten(pt), line_limit=flatten(item_3), wall_width=wall_width)  # -> out, start, end; inputs placement: Point3d, line_limit: Line
# ---------- python: Python ----------
__author__ = "kane"
__version__ = "2020.05.23"

import rhinoscriptsyntax as rs
import Rhino.Geometry as rg
import ghpythonlib.components as ghcomp

result = ghcomp.CurveClosestPoint(placement, line_limit)
point, t_value, distance = result

t_value = line_limit.Length*t_value
if t_value - door_width/2 < wall_width: #0
    start = wall_width
    if t_value + door_width/2 > line_limit.Length - wall_width:
        end = line_limit.Length - wall_width
    else:
        end = door_width
else:
    start = t_value-door_width/2
    remainder = 0
    if t_value + door_width/2 > line_limit.Length - wall_width:
        end = line_limit.Length-wall_width
        remainder = (t_value + door_width/2) - (line_limit.Length - wall_width)
    else:
        end = t_value+door_width/2
    if start - remainder >= wall_width:
        start = start-remainder

#print start, end
start = ghcomp.EvaluateCurve(line_limit, start/line_limit.Length)[0]
end = ghcomp.EvaluateCurve(line_limit, end/line_limit.Length)[0]
# ---------- end python ----------
cp = ClosestPoint(Point=data_2, Cloud=midpt)  # -> ClosestPoint, CPIndex, Distance
item_4 = ListItem(List=item_2, Index=cp.CPIndex, Wrap=True)
ln = Line(StartPoint=python.start, EndPoint=python.end)

cull_2 = CullPattern(List=ln, CullPattern=invert(smaller.SmallerThan))
L = ClusterOutput(cull_2)

# ==== cluster Cluster_4
C = ClusterInput()
t = ClusterInput()
D = ClusterInput()
eval = EvaluateCurve(Curve=graft(C), Parameter=t)  # -> Point, Tangent, Angle
offset = OffsetCurve(Curve=C, Distance=D, Plane=PlaneXY(0, 0, 0), Corners=1)
C_2 = ClusterOutput(offset)
crv_cp = CurveClosestPoint(Point=eval.Point, Curve=offset)  # -> Point, Parameter, Distance
sort = SortList(Keys=crv_cp.Distance, ValuesA=crv_cp.Point, ValuesB=crv_cp.Parameter)  # -> Keys, ValuesA, ValuesB
item = ListItem(List=sort.ValuesA, Index=0, Wrap=True)
i = ClusterOutput(item)
ln = Line(StartPoint=eval.Point, EndPoint=item)
L = ClusterOutput(ln)

# ==== cluster OpenSpaceCalculation
L = ClusterInput()
G = ClusterInput()

# ---- group: Open Space Calculation
item = ListItem(List=flatten(L), Index=0, Wrap=True)
brec = BoundingRectangle(Geometry=G, Plane=item, Axis=0, Slide=0, Union=True)  # -> Bounding, DimensionX, DimensionY
area = Area(Geometry=brec.Bounding)  # -> Area, Centroid
area_2 = Area(Geometry=G)  # -> Area, Centroid
scale = Scale(Geometry=brec.Bounding, Center=area.Centroid, Factor=1.04)  # -> Geometry, Transform
boundary = BoundarySurfaces(Edges=flatten([scale.Geometry, G]))  # disabled
ma = MassAddition(Input=area_2.Area)  # -> Result, PartialResults
division = Division(A=ma.Result, B=area.Area)

# ----
crv = Curve(G)
crv_2 = Curve(scale.Geometry)
boundary_2 = BoundarySurfaces(Edges=flatten([crv, crv_2]), UseTasks=True)
S = ClusterOutput(boundary_2)
subtraction = Subtraction(A="1", B=division)
openpercent = ClusterOutput(division)
builtpercent = ClusterOutput(subtraction)

# ==== cluster Cluster_5
P = ClusterInput()
pcol = PolylineCollapse(Polyline=P, Tolerance=0.1)  # -> Polyline, Count
explode = Explode(Curve=pcol.Polyline, Recursive=True)  # -> Segments, Vertices
end = EndPoints(Curve=explode.Segments)  # -> Start, End
vec2pt = Vector2Pt(PointA=end.Start, PointB=end.End, Unitize=False)  # -> Vector, Length
shift = ShiftList(List=vec2pt.Vector, Shift=1, Wrap=True)
rev = Reverse(Vector=shift)
angle = Angle(VectorA=vec2pt.Vector, VectorB=rev)  # -> Angle, Reflex
smaller = SmallerThan(FirstNumber=angle.Angle, SecondNumber="0.01")  # -> SmallerThan, OrEqualTo
cull = CullPattern(List=end.End, CullPattern=invert(smaller.SmallerThan))
pline = PolyLine(Vertices=cull, Closed=True)
pl = ClusterOutput(pline)

# ==== cluster Cluster_6
C = ClusterInput()
explode = Explode(Curve=C, Recursive=True)  # -> Segments, Vertices
midpt = CurveMiddle(Curve=explode.Segments)
pdecon = Deconstruct(Point=midpt)  # -> XComponent, YComponent, ZComponent
sort = SortList(Keys=pdecon.YComponent, ValuesA=explode.Segments)  # -> Keys, ValuesA
item = ListItem(List=sort.ValuesA, Index=-1, Wrap=True)
index = ItemIndex(List=explode.Segments, Item=item)
shift = ShiftList(List=explode.Segments, Shift=index, Wrap=True)
end = EndPoints(Curve=shift)  # -> Start, End
pline = PolyLine(Vertices=end.Start, Closed=True)  # -> simplify(Polyline)
pl = ClusterOutput(pline)

# ==== cluster Cluster_7
C = ClusterInput()
explode = Explode(Curve=C, Recursive=True)  # -> Segments, Vertices
cullpt = CullDuplicates(Points=flatten(explode.Vertices), Tolerance=0.3, CullMode=3)  # -> Points, Indices, Valence
fsim = FindSimilarMember(Data=explode.Vertices, Set=cullpt.Points)  # -> Hit, Index
P = ClusterOutput(cullpt.Points)
item = ListItem(List=cullpt.Points, Index=fsim.Index, Wrap=True)
pline = PolyLine(Vertices=item, Closed=False)
pl = ClusterOutput(pline)

# ==== cluster Cluster_8
T = ClusterInput()
C = ClusterInput()
explode = Explode(Curve=C, Recursive=True)  # -> Segments, Vertices
P = ClusterInput()
V = ClusterOutput(explode.Vertices)
parcccp = ParClosestCurveCP(Point=P, Curves=explode.Segments, Threshold=T)  # -> Points, Parameters, Index, Distance
cull_i = CullIndex(List=explode.Vertices, Indices=-1, Wrap=True)
larger = LargerThan(FirstNumber=parcccp.Distance, SecondNumber=0)  # -> LargerThan, OrEqualTo
cull = CullPattern(List=parcccp.Parameters, CullPattern=larger.LargerThan)
cull_2 = CullPattern(List=parcccp.Index, CullPattern=larger.LargerThan)
item = ListItem(List=explode.Segments, Index=cull_2, Wrap=True)
eval = EvaluateCurve(Curve=item, Parameter=cull)  # -> simplify(Point), Tangent, Angle
ins = InsertItems(List=simplify(cull_i), Item=simplify(eval.Point), Indices=expr("x+1", simplify(cull_2)), Wrap=True)
pline = PolyLine(Vertices=ins, Closed=True)
pl = ClusterOutput(pline)

# ==== cluster Cluster_9
P = ClusterInput()
pcol = PolylineCollapse(Polyline=P, Tolerance=0.1)  # -> Polyline, Count
explode = Explode(Curve=pcol.Polyline, Recursive=True)  # -> Segments, Vertices
end = EndPoints(Curve=explode.Segments)  # -> Start, End
vec2pt = Vector2Pt(PointA=end.Start, PointB=end.End, Unitize=False)  # -> Vector, Length
shift = ShiftList(List=vec2pt.Vector, Shift=1, Wrap=True)
rev = Reverse(Vector=shift)
angle = Angle(VectorA=vec2pt.Vector, VectorB=rev)  # -> Angle, Reflex
smaller = SmallerThan(FirstNumber=angle.Angle, SecondNumber="0.1")  # -> SmallerThan, OrEqualTo
cull = CullPattern(List=end.End, CullPattern=invert(smaller.SmallerThan))
pline = PolyLine(Vertices=cull, Closed=True)
pl = ClusterOutput(pline)

# ==== cluster Cluster_10
C = ClusterInput()
t = ClusterInput()
eval = EvaluateCurve(Curve=graft(C), Parameter=t)  # -> Point, Tangent, Angle
C_2 = ClusterOutput(C)
crv_cp = CurveClosestPoint(Point=eval.Point, Curve=C)  # -> Point, Parameter, Distance
sort = SortList(Keys=crv_cp.Distance, ValuesA=crv_cp.Point, ValuesB=crv_cp.Parameter)  # -> Keys, ValuesA, ValuesB
item = ListItem(List=sort.ValuesA, Index=0, Wrap=True)
i = ClusterOutput(item)
ln = Line(StartPoint=eval.Point, EndPoint=item)
L = ClusterOutput(ln)

# ==== cluster Cluster_11
C = ClusterInput()
T = ClusterInput()
P = ClusterInput()
explode = Explode(Curve=C, Recursive=True)  # -> Segments, Vertices
midpt = CurveMiddle(Curve=explode.Segments)
branch = TreeBranch(Tree=T, Path=P, MaintainPaths=True)
incurve = PointInCurve(Point=midpt, Curve=branch)  # -> Relationship, Point
equals = Equality(FirstNumber=incurve.Relationship, SecondNumber=1)  # -> Equality, Inequality
cull = CullPattern(List=midpt, CullPattern=equals.Equality)
lng = ListLength(List=flatten(cull))
equals_2 = Equality(FirstNumber=lng, SecondNumber=0)  # -> Equality, Inequality
filter = StreamFilter(Gate=equals_2.Equality, Stream0=branch, Stream1=C)
panel = Panel("""0,1,0
-1,2,0
1,2,0""")
gate = StreamGate(Stream=midpt, Gate=equals_2.Equality)  # -> Target0, Target1
crv_cp = CurveClosestPoint(Point=flatten(gate.Target1), Curve=branch)  # -> Point, Parameter, Distance
pt = Point(panel)
xy = XYPlane(Origin=Point(0, 0, 0))
pline = PolyLine(Vertices=pt, Closed=True)
sort = SortList(Keys=crv_cp.Distance, ValuesA=gate.Target1)  # -> Keys, ValuesA
boundary = BoundarySurfaces(Edges=pline)
item = ListItem(List=sort.ValuesA, Index=0, Wrap=True)
filter_2 = StreamFilter(Gate=equals_2.Equality, Stream0=cull, Stream1=item)
circle = CircleCNR(Center=filter_2, Normal=Vector(0, 0, 1), Radius=1)
crv_cp_2 = CurveClosestPoint(Point=filter_2, Curve=filter)  # -> Point, Parameter, Distance
eval = EvaluateCurve(Curve=filter, Parameter=crv_cp_2.Parameter)  # -> Point, Tangent, Angle
vrot = Rotate(Vector=eval.Tangent, Axis=xy, Angle=-1.570796327)
average = Average(Input=filter_2)
pl = ConstructPlane(Origin=eval.Point, XAxis=eval.Tangent, YAxis=vrot)
orient = Orient(Geometry=boundary, Source=PlaneXY(0, 0, 0), Target=pl)  # -> Geometry, Transform
C_2 = ClusterOutput([circle, orient.Geometry])
arithmetic_mean = ClusterOutput(average)

# ==== cluster Cluster_12
G = ClusterInput()
area = Area(Geometry=G)  # -> Area, Centroid
smaller = SmallerThan(FirstNumber=area.Area, SecondNumber=1)  # -> SmallerThan, OrEqualTo
cull = CullPattern(List=G, CullPattern=smaller.SmallerThan)
offcrv = OffsetCurve(Curve=graft(cull), Plane=PlaneXY(0, 0, 0), Distance="0.4", BothSides=True, Kinks=0, CapType=1)
area_2 = Area(Geometry=offcrv)  # -> Area, Centroid
rectangle = Rectangle(Plane=PlaneXY(0, 0, 0), XSize=Domain(-0.2, 0.2), YSize=Domain(-0.2, 0.2), Radius=0)  # -> Rectangle, Length
sort = SortList(Keys=area_2.Area, ValuesB=offcrv)  # -> Keys, ValuesB
boundary = BoundarySurfaces(Edges=rectangle.Rectangle)
mesh = Mesh(boundary)
item = ListItem(List=sort.ValuesB, Index=-1, Wrap=True)
explode = Explode(Curve=item, Recursive=True)  # -> Segments, Vertices
len = Length(Curve=explode.Segments)
panel = Panel("""0
-1""")
division = Division(A=len, B="0.4")
xy = XYPlane(Origin=Point(0, 0, 0))
int = Integer(division)
divide = DivideCurve(Curve=explode.Segments, Count=int, Kinks=False)  # -> Points, Tangents, Parameters
cull_i = CullIndex(List=divide.Points, Indices=panel, Wrap=True)
cull_i_2 = CullIndex(List=divide.Tangents, Indices=panel, Wrap=True)
vrot = Rotate(Vector=cull_i_2, Axis=xy, Angle=-1.570796327)
pl = ConstructPlane(Origin=cull_i, XAxis=cull_i_2, YAxis=vrot)
orient = Orient(Geometry=mesh, Source=PlaneXY(0, 0, 0), Target=pl)  # -> Geometry, Transform
G_2 = ClusterOutput(orient.Geometry)

# ==== cluster Cluster_13
vd = ClusterInput()
vd_2 = ViewingDirection(vd)
pt = ClusterInput()
pt_2 = ClusterInput()
crv = ClusterInput()
num = ClusterInput()
pt_3 = Point(pt)
pt_4 = Point(pt_2)
crv_2 = Curve(crv)
num_2 = Number(num)
ghpython_script = GhPythonScript(start_pt=pt_3, nav_pt=pt_4, OL=crv_2, VR=num_2, VD=vd_2)  # -> out, cnt, simplify(pl); inputs start_pt: Point3d, nav_pt: list of Point3d, OL: list of Line, VR: Int32, VD: Vector3d
# ---------- ghpython_script: Python ----------
import ghpythonlib.components as ghcomp
import copy
import ghpythonlib.treehelpers as th

Global_check = 0

def ensure_list(lst):
    if not isinstance(lst, list):
        return [lst]
    else:
        return lst

def traverse(pt, ptlist, counter = 0, pl = []):
    pl.append(pt)
    pl = copy.deepcopy(pl)
    ptlist = copy.deepcopy(ptlist) # make a copy so not to change for other branches.
    counter += 1
    # generate isovist with global settings and obstacles
    isovist = ghcomp.DecodingSpacesAssembly.Isovist(pt, OL, VD, VR, 360, 360, True, False, False)[0]
    # check what isovist areas encapsulate points
    viewable_pts = []#viewable pts not already viewed
    points_visible = ensure_list(ghcomp.PointInCurve(ptlist , isovist)[0])
    #print points_visible
    total = len(points_visible)-1
    #print "total:", total
    for i, test in enumerate(points_visible):
        #print len(points_visible)
        #if inside
        test = points_visible[total -i]
        k = total-i
        #print test
        if test == 2:
            try:
                viewable_pts.append(ptlist[k])
                new_pt = ptlist.pop(k)
                #print list(traverse(new_pt, ptlist, counter, pl))
                
                for part in traverse(new_pt, ptlist, counter, pl):
                    yield part
            except:
                yield [pt], counter, pl
                pass
    #stop scenario - all points found
    if len(ptlist) == 0:
        yield ptlist,counter,pl
    
    #stop scenario - not viewable points
    elif len(viewable_pts) == 0:
        yield ptlist,counter,pl
    
    #else:
        #yield ptlist,counter,pl

counts, polylines = [], []
#print(list(list(traverse(start_pt, nav_pt))[0]))

for branch in list(traverse(start_pt, nav_pt,0, [])):
    counts.append(branch[1])
    polylines.append(branch[2])

cnt,pl = th.list_to_tree(counts, None), th.list_to_tree(polylines, None) #min(counts)

"""
while len(nav_pt_checklist) != 0:
    
    buffer_pts = []
    for ip, cur_pt in enumerate(test_pts): #TODO add a new counter and keep track of how many points it takes to view all of them.
        isovist = ghcomp.DecodingSpacesAssembly.Isovist(cur_pt, OL, VD, VR, 360, 360, True, False, False)[0]
        vpoint_indeces = []
        for i, test in enumerate(ghcomp.PointInCurve(nav_pt_checklist , isovist)[0]):
            if test == 2:
                counters.append(1) #Add a checklist
                checklists.append(nav_pt[:]) #Add a checklist
                vpoint_indeces.append(i) #skewing indeces
        buffer_pts = [nav_pt_checklist[i] for i in vpoint_indeces]
        for index in sorted(vpoint_indeces, reverse=True):
            del nav_pt_checklist[index]
    test_pts = buffer_pts
    force_stop += 1
    
    if force_stop >= 10:
        print "Force Stopped"
        break
"""
# ---------- end ghpython_script ----------
ghpython_script_2 = GhPythonScript(start_pt=pt_3, nav_pt=pt_4, OL=crv_2, VR=num_2, VD=vd_2)  # -> out, cnt, simplify(pl); inputs start_pt: Point3d, nav_pt: list of Point3d, OL: list of Line, VR: Int32, VD: Vector3d; same code as ghpython_script
ghpython_script_3 = GhPythonScript(start_pt=pt_3, nav_pt=pt_4, OL=crv_2, VR=num_2, VD=vd_2)  # -> out, cnt, pl; inputs start_pt: Point3d, nav_pt: list of Point3d, OL: list of Line, VR: Int32, VD: Vector3d; disabled
# ---------- ghpython_script_3: Python ----------
import ghpythonlib.components as ghcomp
import copy
import ghpythonlib.treehelpers as th

#nav_pt_checklist = nav_pt[:] #you need this for each branch
#checklists = []
#test_pts = [start_pt]
#force_stop = 0
#counters = []

def ensure_list(lst):
    if not isinstance(lst, list):
        return [lst]
    else:
        return lst

def traverse(pt, ptlist, counter = 0, pl = []):
    pl.append(pt)
    ptlist = copy.deepcopy(ptlist) # make a copy so not to change for other branches.
    counter += 1
    # generate isovist with global settings and obstacles
    isovist = ghcomp.DecodingSpacesAssembly.Isovist(pt, OL, VD, VR, 360, 360, True, False, False)[0]
    # check what isovist areas encapsulate points
    viewable_pts = []#viewable pts not already viewed
    points_visible = ensure_list(ghcomp.PointInCurve(ptlist , isovist)[0])
    #print points_visible
    total = len(points_visible)-1
    #print "total:", total
    for i, test in enumerate(points_visible):
        #print len(points_visible)
        #if inside
        test = points_visible[total -i]
        k = total-i
        #print test
        if test == 2:
            try:
                viewable_pts.append(ptlist[k])
                new_pt = ptlist.pop(k)
                #print list(traverse(new_pt, ptlist, counter, pl))
                
                ptlist, counter, pl = list(traverse(new_pt, ptlist, counter, pl))[0]
            except:
                ptlist, counter, pl = [pt], counter, pl
                pass
    #stop scenario - all points found
    if len(ptlist) == 0:
        yield ptlist,counter,pl
    
    #stop scenario - not viewable points
    elif len(viewable_pts) == 0:
        yield ptlist,counter,pl
    
    else:
        yield ptlist,counter,pl

counts, polylines = [], []
print(list(list(traverse(start_pt, nav_pt))[0]))

for branch in list(list(traverse(start_pt, nav_pt))):
    counts.append(branch[1])
    polylines.append(branch[2])

cnt,pl = min(counts), th.list_to_tree(polylines, None)

"""
while len(nav_pt_checklist) != 0:
    
    buffer_pts = []
    for ip, cur_pt in enumerate(test_pts): #TODO add a new counter and keep track of how many points it takes to view all of them.
        isovist = ghcomp.DecodingSpacesAssembly.Isovist(cur_pt, OL, VD, VR, 360, 360, True, False, False)[0]
        vpoint_indeces = []
        for i, test in enumerate(ghcomp.PointInCurve(nav_pt_checklist , isovist)[0]):
            if test == 2:
                counters.append(1) #Add a checklist
                checklists.append(nav_pt[:]) #Add a checklist
                vpoint_indeces.append(i) #skewing indeces
        buffer_pts = [nav_pt_checklist[i] for i in vpoint_indeces]
        for index in sorted(vpoint_indeces, reverse=True):
            del nav_pt_checklist[index]
    test_pts = buffer_pts
    force_stop += 1
    
    if force_stop >= 10:
        print "Force Stopped"
        break
"""
# ---------- end ghpython_script_3 ----------
polyline = PolyLine(Vertices=ghpython_script.pl, Closed=False)  # -> flatten(Polyline)
sort_list = SortList(Keys=ghpython_script.cnt, ValuesValuesA=polyline)  # -> Keys, ValuesValuesA
list_item = ListItem(List=sort_list.ValuesValuesA, Index=0, Wrap=True)
curve_closest_point = CurveClosestPoint(Point=pt_4, Curve=graft(sort_list.ValuesValuesA))  # -> Point, Parameter, Distance
larger_than = LargerThan(FirstNumber=curve_closest_point.Distance, SecondNumber=Slider(0.1, range=0..0.1))  # -> LargerThan, OrEqualTo
mass_addition = MassAddition(Input=larger_than.LargerThan)  # -> flatten(Result), PartialResults
cull_pattern = CullPattern(List=pt_4, CullPattern=larger_than.LargerThan)
addition = Addition(A=sort_list.Keys, B=mass_addition.Result)
sort_list_2 = SortList(Keys=addition)  # -> Keys, ValuesValuesA
list_length = ListLength(List=pt_4)
list_item_2 = ListItem(List=sort_list_2.Keys, Index=0, Wrap=True)
division = Division(A=list_item_2, B=list_length)
result = ClusterOutput(division)
